# Grasshopper definition ordering objects.gh (Grasshopper 1.0.7)
# plug-ins: Pufferfish, Human, EleFront

geometry = Geometry([<mesh referenced from the Rhino model> x5000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])
modify_elefront_attributes = ModifyElefrontAttributes(ReferencedGeometryOrElefrontAttributes=geometry)
get_rhino_attributes = GetRhinoAttributes(Geometry=geometry)  # -> Name, Layer, Color
graft_tree = GraftTree(Tree=geometry, IncludeEmptyLists=True, IncludeNullItems=True)
area = Area(Geometry=graft_tree)  # -> Area, Centroid
geometry_2 = Geometry([<mesh referenced from the Rhino model> x2])
deconstruct = Deconstruct(Point=area.Centroid)  # -> XComponent, YComponent, ZComponent
geometry_3 = Geometry([<brep referenced from the Rhino model> x5000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])
duplicate_data = DuplicateData(Data="Plank number", Number="2", Order=True)
list_indices = ListIndices(List=geometry_2)
list_item = ListItem(List=geometry_3, Index=0, Wrap=True)
panel = Panel(list_indices)
multiplication = Multiplication(A=deconstruct.ZComponent, B=10)
panel_2 = Panel("2")
list_length = ListLength(List=graft_tree)
createattributes = CreateAttributes(
    LayerName="test",
    PlotWeight=list_indices,
    UserDataKeys=duplicate_data,
    UserDataValues=list_indices,
    enableFullPath=False)
deconstruct_brep = DeconstructBrep(Brep=geometry_3)  # -> Faces, Edges, Vertices
integer = Integer(multiplication)
list_indices_2 = ListIndices(List=flatten(graft_tree))  # -> graft(Indices)
division = Division(A=integer, B=10)
duplicate_data_2 = DuplicateData(Data="Name", Number=list_length, Order=True)
list_indices_3 = ListIndices(List=geometry_2)
list_length_2 = ListLength(List=graft_tree)
trim_tree = TrimTree(Tree=duplicate_data_2, Depth=1)
deconstruct_brep_2 = DeconstructBrep(Brep=deconstruct_brep.Faces)  # -> Faces, Edges, Vertices
duplicate_data_3 = DuplicateData(Data="Position", Number=list_length_2, Order=True)
modify_object_attributes = ModifyObjectAttributes()
bake_geometry = BakeGeometry(Bake=geometry_2, Geometry=geometry_2, Attributes=createattributes, DeleteOldBakes=False, PreserveTrees=False)
concatenate = Concatenate(FragmentA="I am a plank number: ", FragmentB=list_indices_2)
panel_3 = Panel(list_indices_2)
trim_tree_2 = TrimTree(Tree=duplicate_data_3, Depth=1)
join_curves = JoinCurves(Curves=deconstruct_brep_2.Edges, Preserve=False)
concatenate_2 = Concatenate(Fragment_A="My center is ", Fragment_B=division, A=" cm from the ground")
panel_4 = Panel(concatenate_2)
trim_tree_3 = TrimTree(Tree=join_curves, Depth=1)
define_object_attributes = DefineObjectAttributes(UserKeys=trim_tree, UserValues=concatenate, Name=concatenate, Layer="MESHED_TRUSS")
define_object_attributes_2 = DefineObjectAttributes(UserKeys=trim_tree_2, UserValues=concatenate_2, Name=concatenate, Layer="MESHED_TRUSS")
polyline_to_mesh = PolylineToMesh(Polyline=trim_tree_3, Quadrangulate=True)
panel_5 = Panel(join_curves)
trim_tree_4 = TrimTree(Tree=polyline_to_mesh, Depth=1)
modify_rhinoobject_attributes = ModifyRhinoObjectAttributes(Geometry=graft_tree, Attributes=define_object_attributes, Modify=False)
modify_rhinoobject_attributes_2 = ModifyRhinoObjectAttributes(Geometry=graft_tree, Attributes=define_object_attributes_2, Modify=False)
boolean_toggle = BooleanToggle(True)
mesh_join = MeshJoin(Meshes=trim_tree_4)
panel_6 = Panel(mesh_join)
rebuild_mesh = RebuildMesh(
    Mesh=mesh_join,
    RebuildNormals=boolean_toggle,
    CullUnused=boolean_toggle,
    UnifyNormals=boolean_toggle,
    FlipNormals=False,
    IdenticalCombine=boolean_toggle,
    WeldVertices=0)
face_normals = FaceNormals()  # -> Centers, Normals
amplitude = Amplitude(Vector=face_normals.Normals, Amplitude=Slider(0.1, range=0..2))
data = Data(rebuild_mesh)
vector_display = VectorDisplay(Anchor=face_normals.Centers, Vector=amplitude)
